# Grasshopper definition Layer Table - Grasshopper defintion - by DyvikDesign.gh (Grasshopper 0.8.66)

pocket_remain_depth_mm = Slider(6, range=0..20)
profille_thickness_mm = Slider(70, range=0..160)
pressfit_compensation = Slider(0, range=-1..1)
material_thickness_mm = Slider(18.5, range=0..60)
number_of_leg_layers = Slider(3, range=2..6)
leg_thickness_ratio = Slider(0.756, range=0.02..0.9)
top_plate_thickness = Slider(12, range=0..120)
milling_bit_ø_mm = Slider(3.18, range=1..10)
table_height_mm = Slider(740, range=0..1500)
# by DyvikDesign
# 
# www.dyvikdesign.com
# 
# License:
# Creative Commons
# Attribution-NonCommercial-ShareAlike
# CC BY-NC-SA
plate_length_mm = Slider(1020.4, range=0..2400)
plate_width_mm = Slider(700.4, range=0..2400)
leg_inclining = Slider(0.486, range=0.02..1)
inner_fillet_ratio = Slider(0.463, range=0.02..0.9)
fillet_sharpness = Slider(0.629, range=0.02..0.9)
leg_fillet_ratio = Slider(0.379, range=0.02..0.49)
nesting_space = Slider(53, range=10..400)
fillet_ratio = Slider(0.6, range=0.02..0.9)
subtraction = Subtraction(A=number_of_leg_layers, B=1)
multiplication = Multiplication(A=profille_thickness_mm, B=leg_thickness_ratio)
division = Division(A=plate_length_mm, B=2)
multiplication_2 = Multiplication(A=profille_thickness_mm, B=fillet_ratio)
division_2 = Division(A=plate_width_mm, B=2)
series = Series(Start=material_thickness_mm, Step=material_thickness_mm, Count=subtraction)
multiplication_3 = Multiplication(A=multiplication, B=leg_inclining)
num = Number(multiplication_2)
neg = Negative(Value=division)
neg_2 = Negative(Value=division_2)
multiplication_4 = Multiplication(A=num, B=fillet_sharpness)
multiplication_5 = Multiplication(A=multiplication_3, B=leg_fillet_ratio)
neg_3 = Negative(Value=num)
rad = Radians(Degrees=180)
xy = XYPlane(Origin=Point(0, 0, 0))
dom = Domain(DomainStart=neg, DomainEnd=division)
dom_2 = Domain(DomainStart=neg_2, DomainEnd=division_2)
neg_4 = Negative(Value=top_plate_thickness)
pt = PointXYZ(XComponent=0, YComponent=division_2, ZComponent=0, System=PlaneXY(0, 0, 0))
pt_2 = PointXYZ(XComponent=0, YComponent=neg_2, ZComponent=0, System=PlaneXY(0, 0, 0))
multiplication_6 = Multiplication(A=num, B=inner_fillet_ratio)
division_3 = Division(A=milling_bit_ø_mm, B=2)
neg_5 = Negative(Value=multiplication_4)
multiplication_7 = Multiplication(A=multiplication_5, B=fillet_ratio)
xy_2 = XYPlane(Origin=Point(0, 0, 0))
addition = Addition(A=neg_2, B=neg_3)
addition_2 = Addition(A=material_thickness_mm, B=pressfit_compensation)
subtraction_2 = Subtraction(A=multiplication, B=num)
addition_3 = Addition(A=division_3, B=0.5)
multiplication_8 = Multiplication(A=addition_3, B=2)
Z = UnitZ(Factor=neg_4)
rectangle = Rectangle(Plane=xy, XSize=dom, YSize=dom_2, Radius=0)  # -> Rectangle, Length
X = UnitX(Factor=multiplication_6)
Y = UnitY(Factor=multiplication_6)
X_2 = UnitX(Factor=neg_5)
Y_2 = UnitY(Factor=neg_5)
subtraction_3 = Subtraction(A=material_thickness_mm, B=pocket_remain_depth_mm)
arc = Arc(Plane=xy_2, Radius=addition_3, Angle=rad)  # -> Arc, Length
addition_4 = Addition(A=neg_2, B=subtraction_2)
pt_3 = PointXYZ(XComponent=num, YComponent=addition, ZComponent=0, System=PlaneXY(0, 0, 0))
X_3 = UnitX(Factor=addition_3)
extr = Extrude(Base=rectangle.Rectangle, Direction=Z)
multiplication_9 = Multiplication(A=inner_fillet_ratio, B=neg_5)
subtraction_4 = Subtraction(A=division, B=subtraction_3)
move = Move(Geometry=arc.Arc, Motion=X_3)  # -> Geometry, Transform
subtraction_5 = Subtraction(A=addition_2, B=multiplication_8)
pt_4 = PointXYZ(XComponent=profille_thickness_mm, YComponent=addition_4, ZComponent=0, System=PlaneXY(0, 0, 0))
cap = CapHoles(Brep=extr)
move_2 = Move(Geometry=pt_4, Motion=Y)  # -> Geometry, Transform
X_4 = UnitX(Factor=subtraction_5)
move_3 = Move(Geometry=pt_4, Motion=X)  # -> Geometry, Transform
neg_6 = Negative(Value=multiplication_5)
pt_5 = PointXYZ(XComponent=subtraction_4, YComponent=0, ZComponent=0, System=PlaneXY(0, 0, 0))
Y_3 = UnitY(Factor=multiplication_9)
multiplication_10 = Multiplication(A=subtraction, B=material_thickness_mm)
xz = XZPlane(Origin=Point(0, 0, 0))
pt_6 = PointXYZ(XComponent=table_height_mm, YComponent=addition, ZComponent=0, System=PlaneXY(0, 0, 0))
move_4 = Move(Geometry=move.Geometry, Motion=X_4)  # -> Geometry, Transform
Y_4 = UnitY(Factor=multiplication_5)
X_5 = UnitX(Factor=neg_6)
end = EndPoints(Curve=move_4.Geometry)  # -> Start, End
end_2 = EndPoints(Curve=move.Geometry)  # -> Start, End
mirror = Mirror(Geometry=move_2.Geometry, Plane=xz)  # -> Geometry, Transform
X_6 = UnitX(Factor=multiplication_10)
Y_5 = UnitY(Factor=multiplication_3)
rad_2 = Radians(Degrees=270)
neg_7 = Negative(Value=multiplication_5)
ln = Line(StartPoint=end.End, EndPoint=end_2.Start)
rev = Reverse(Vector=X_6)
move_5 = Move(Geometry=pt_6, Motion=X_5)  # -> Geometry, Transform
move_6 = Move(Geometry=move_5.Geometry, Motion=Y_5)  # -> Geometry, Transform
vec2pt = Vector2Pt(PointA=move_3.Geometry, PointB=move_6.Geometry, Unitize=False)  # -> Vector, Length
amp = Amplitude(Vector=vec2pt.Vector, Amplitude=multiplication_9)
Y_6 = UnitY(Factor=neg_7)
rad_3 = Radians(Degrees=90)
join = JoinCurves(Curves=flatten([ln, move_4.Geometry, move.Geometry]), Preserve=False)
rotate = Rotate(Geometry=join, Angle=rad_2, Plane=xy_2)  # -> Geometry, Transform
X_7 = UnitX(Factor=multiplication_5)
rotate_2 = Rotate(Geometry=arc.Arc, Angle=rad_3, Plane=xy_2)  # -> Geometry, Transform
move_7 = Move(Geometry=move_6.Geometry, Motion=X_7)  # -> Geometry, Transform
end_3 = EndPoints(Curve=rotate.Geometry)  # -> Start, End
vec2pt_2 = Vector2Pt(PointA=end_3.Start, PointB=pt_2, Unitize=False)  # -> Vector, Length
end_4 = EndPoints(Curve=rotate_2.Geometry)  # -> Start, End
Y_7 = UnitY(Factor=multiplication_7)
move_8 = Move(Geometry=pt_6, Motion=Y_4)  # -> Geometry, Transform
move_9 = Move(Geometry=move_7.Geometry, Motion=Y_6)  # -> Geometry, Transform
move_10 = Move(Geometry=rotate.Geometry, Motion=vec2pt_2.Vector)  # -> Geometry, Transform
ln_2 = Line(StartPoint=move_6.Geometry, EndPoint=move_5.Geometry)
divide = DivideCurve(Curve=ln_2, Count=2, Kinks=False)  # -> Points, Tangents, Parameters
division_4 = Division(A=profille_thickness_mm, B=1.5)
subtraction_6 = Subtraction(A=division_4, B=top_plate_thickness)
neg_8 = Negative(Value=subtraction_6)
Y_8 = UnitY(Factor=neg_8)
move_11 = Move(Geometry=pt_5, Motion=Y_8)  # -> Geometry, Transform
addition_5 = Addition(A=profille_thickness_mm, B=neg_8)
move_12 = Move(Geometry=move_11.Geometry, Motion=rev)  # -> Geometry, Transform
subtraction_7 = Subtraction(A=addition_5, B=top_plate_thickness)
neg_9 = Negative(Value=subtraction_7)
vec2pt_3 = Vector2Pt(PointA=end_4.Start, PointB=move_12.Geometry, Unitize=False)  # -> Vector, Length
Y_9 = UnitY(Factor=neg_9)
move_13 = Move(Geometry=move_12.Geometry, Motion=Y_9)  # -> Geometry, Transform
X_8 = UnitX(Factor=multiplication_7)
rev_2 = Reverse(Vector=Y_7)
ln_3 = Line(StartPoint=pt_5, EndPoint=move_11.Geometry)
move_14 = Move(Geometry=rotate_2.Geometry, Motion=vec2pt_3.Vector)  # -> Geometry, Transform
end_5 = EndPoints(Curve=move_14.Geometry)  # -> Start, End
ln_4 = Line(StartPoint=end_5.End, EndPoint=move_13.Geometry)
ln_5 = Line(StartPoint=end_5.Start, EndPoint=move_11.Geometry)
len = Length(Curve=ln_2)
X_9 = UnitX(Factor=len)
X_10 = UnitX(Factor=len)
Y_10 = UnitY(Factor=len)
rev_3 = Reverse(Vector=X_9)
rev_4 = Reverse(Vector=Y_10)
item = ListItem(List=divide.Points, Index=1, Wrap=False)
X_11 = UnitX(Factor=division_4)
amp_2 = Amplitude(Vector=vec2pt.Vector, Amplitude=multiplication_7)
yz = YZPlane(Origin=Point(0, 0, 0))
join_2 = JoinCurves(Curves=flatten([ln_3, move_14.Geometry, ln_5, ln_4]), Preserve=False)
move_15 = Move(Geometry=item, Motion=rev_3)  # -> Geometry, Transform
bzspan = BezierSpan(StartPoint=move_2.Geometry, StartTangent=Y_3, EndPoint=move_3.Geometry, EndTangent=amp)  # -> Curve, Length, Domain
bzspan_2 = BezierSpan(StartPoint=move_8.Geometry, StartTangent=rev_2, EndPoint=move_5.Geometry, EndTangent=X_8)  # -> Curve, Length, Domain
bzspan_3 = BezierSpan(StartPoint=pt_2, StartTangent=Y_2, EndPoint=pt_3, EndTangent=X_2)  # -> Curve, Length, Domain
bzspan_4 = BezierSpan(StartPoint=move_6.Geometry, StartTangent=amp_2, EndPoint=move_9.Geometry, EndTangent=Y_7)  # -> Curve, Length, Domain
ln_6 = Line(StartPoint=move_6.Geometry, EndPoint=move_3.Geometry)
ln_7 = Line(StartPoint=move_2.Geometry, EndPoint=mirror.Geometry)
ln_8 = Line(StartPoint=pt_3, EndPoint=move_5.Geometry)
ln_9 = Line(StartPoint=pt, EndPoint=pt_2)
ln_10 = Line(StartPoint=move_9.Geometry, EndPoint=move_8.Geometry)
mirror_2 = Mirror(Geometry=join_2, Plane=yz)  # -> Geometry, Transform
subtraction_8 = Subtraction(A=division_4, B=top_plate_thickness)
X_12 = UnitX(Factor=subtraction_8)
end_6 = EndPoints(Curve=join_2)  # -> Start, End
end_7 = EndPoints(Curve=mirror_2.Geometry)  # -> Start, End
division_5 = Division(A=milling_bit_ø_mm, B=2)
end_8 = EndPoints(Curve=ln_9)  # -> Start, End
join_3 = JoinCurves(Curves=flatten([ln_8, ln_10, ln_6, bzspan_4.Curve, bzspan_2.Curve, bzspan.Curve, bzspan_3.Curve]), Preserve=False)
xz_2 = XZPlane(Origin=Point(0, 0, 0))
move_16 = Move(Geometry=move_10.Geometry, Motion=X_11)  # -> Geometry, Transform
multiplication_11 = Multiplication(A=profille_thickness_mm, B=1.4)
ln_11 = Line(StartPoint=end_6.Start, EndPoint=end_7.Start)
ln_12 = Line(StartPoint=end_6.End, EndPoint=end_7.End)
rev_5 = Reverse(Vector=X_12)
end_9 = EndPoints(Curve=move_16.Geometry)  # -> Start, End
Y_11 = UnitY(Factor=multiplication_11)
move_17 = Move(Geometry=end_9.End, Motion=rev_5)  # -> Geometry, Transform
mirror_3 = Mirror(Geometry=join_3, Plane=xz_2)  # -> Geometry, Transform
move_18 = Move(Geometry=move_17.Geometry, Motion=Y_11)  # -> Geometry, Transform
crv_cp = CurveCP(Point=move_18.Geometry, Curve=ln_7)  # -> Point, Parameter, Distance
join_4 = JoinCurves(Curves=flatten([ln_11, ln_12, join_2, mirror_2.Geometry]), Preserve=False)
dom_3 = Domain(DomainStart=-0.5, DomainEnd=top_plate_thickness)
ln_13 = Line(StartPoint=end_9.End, EndPoint=move_17.Geometry)
ln_14 = Line(StartPoint=end_8.End, EndPoint=end_9.Start)
ln_15 = Line(StartPoint=move_18.Geometry, EndPoint=move_17.Geometry)
ln_16 = Line(StartPoint=move_18.Geometry, EndPoint=crv_cp.Point)
divide_2 = DivideCurve(Curve=ln_16, Count=2, Kinks=False)  # -> Points, Tangents, Parameters
item_2 = ListItem(List=divide_2.Points, Index=1, Wrap=False)
move_19 = Move(Geometry=item_2, Motion=rev_4)  # -> Geometry, Transform
xy_3 = XYPlane(Origin=[move_15.Geometry, move_19.Geometry])
cir = Circle(Plane=xy_3, Radius=division_5)
mirror_4 = Mirror(Geometry=cir, Plane=xz_2)  # -> Geometry, Transform
ln_17 = Line(StartPoint=crv_cp.Point, EndPoint=move_2.Geometry)
rectangle_2 = Rectangle(Plane=xy, XSize=dom_3, YSize=dom_2, Radius=0)  # -> Rectangle, Length
explode = Explode(Curve=rectangle_2.Rectangle, Recursive=True)  # -> Segments, Vertices
pt_7 = PointXYZ(XComponent=10000, YComponent=0, ZComponent=0, System=PlaneXY(0, 0, 0))
join_5 = JoinCurves(Curves=flatten([join_3, ln_14, ln_13, move_16.Geometry, ln_15, ln_16, ln_17]), Preserve=False)
join_6 = JoinCurves(Curves=flatten([mirror_3.Geometry, join_3, ln_7, ln_9]), Preserve=False)
item_3 = ListItem(List=explode.Segments, Index=1, Wrap=False)
end_10 = EndPoints(Curve=item_3)  # -> Start, End
dist = Distance(PointA=move_18.Geometry, PointB=pt_3)
ln_18 = Line(StartPoint=crv_cp.Point, EndPoint=pt_6)
rad_4 = Radians(Degrees=270)
addition_6 = Addition(A=dist, B=nesting_space)
divide_3 = DivideCurve(Curve=ln_18, Count=2, Kinks=False)  # -> Points, Tangents, Parameters
multiplication_12 = Multiplication(A=subtraction, B=2)
rotate_3 = Rotate(Geometry=arc.Arc, Angle=rad_4, Plane=xy_2)  # -> Geometry, Transform
item_4 = ListItem(List=divide_3.Points, Index=1, Wrap=False)
end_11 = EndPoints(Curve=rotate_3.Geometry)  # -> Start, End
crv = Curve(cir)
rad_5 = Radians(Degrees=[90, 270])
xy_4 = XYPlane(Origin=item_4)
group = Group(Objects=flatten([join_5, crv]))
vec2pt_4 = Vector2Pt(PointA=end_11.End, PointB=end_10.End, Unitize=False)  # -> Vector, Length
vec2pt_5 = Vector2Pt(PointA=end_11.Start, PointB=end_10.Start, Unitize=False)  # -> Vector, Length
rad_6 = Radians(Degrees=-90)
xz_3 = XZPlane(Origin=Point(0, 0, 0))
cull_i = CullIndex(List=explode.Segments, Indices=1, Wrap=False)
rotate_4 = Rotate(Geometry=group, Angle=rad_5, Plane=xy_4)  # -> Geometry, Transform
move_20 = Move(Geometry=rotate_3.Geometry, Motion=vec2pt_5.Vector)  # -> Geometry, Transform
move_21 = Move(Geometry=rotate_3.Geometry, Motion=vec2pt_4.Vector)  # -> Geometry, Transform
rotate_5 = Rotate(Geometry=join_6, Angle=rad_6, Plane=xz_3)  # -> Geometry, Transform
rotate_6 = Rotate(Geometry=join_5, Angle=rad_6, Plane=xz_3)  # -> Geometry, Transform
division_6 = Division(A=table_height_mm, B=2)
addition_7 = Addition(A=division, B=nesting_space)
end_12 = EndPoints(Curve=move_21.Geometry)  # -> Start, End
end_13 = EndPoints(Curve=move_20.Geometry)  # -> Start, End
Z_2 = UnitZ(Factor=table_height_mm)
Z_3 = UnitZ(Factor=table_height_mm)
addition_8 = Addition(A=division_6, B=profille_thickness_mm)
rad_7 = Radians(Degrees=90)
yz_2 = YZPlane(Origin=Point(0, 0, 0))
ln_19 = Line(StartPoint=end_13.End, EndPoint=end_12.Start)
move_22 = Move(Geometry=rotate_5.Geometry, Motion=Z_2)  # -> Geometry, Transform
subtraction_9 = Subtraction(A=series, B=pocket_remain_depth_mm)
move_23 = Move(Geometry=rotate_6.Geometry, Motion=Z_3)  # -> Geometry, Transform
X_13 = UnitX(Factor=addition_7)
subtraction_10 = Subtraction(A=profille_thickness_mm, B=top_plate_thickness)
subtraction_11 = Subtraction(A=table_height_mm, B=top_plate_thickness)
addition_9 = Addition(A=addition_7, B=addition_8)
addition_10 = Addition(A=division, B=pocket_remain_depth_mm)
neg_10 = Negative(Value=subtraction_9)
join_7 = JoinCurves(Curves=[cull_i, move_21.Geometry, move_20.Geometry, ln_19], Preserve=False)
rotate_7 = Rotate(Geometry=join_4, Angle=rad_7, Plane=yz_2)  # -> Geometry, Transform
addition_11 = Addition(A=subtraction_10, B=nesting_space)
addition_12 = Addition(A=division_2, B=nesting_space)
Z_4 = UnitZ(Factor=subtraction_11)
X_14 = UnitX(Factor=addition_10)
addition_13 = Addition(A=division, B=neg_10)
pt_8 = PointXYZ(XComponent=addition_9, YComponent=0, ZComponent=0, System=PlaneXY(0, 0, 0))
series_2 = Series(Start=addition_12, Step=addition_11, Count=2)
move_24 = Move(Geometry=move_22.Geometry, Motion=X_14)  # -> Geometry, Transform
move_25 = Move(Geometry=rotate_7.Geometry, Motion=Z_4)  # -> Geometry, Transform
Y_12 = UnitY(Factor=division_2)
X_15 = UnitX(Factor=material_thickness_mm)
X_16 = UnitX(Factor=addition_13)
neg_11 = Negative(Value=material_thickness_mm)
rad_8 = Radians(Degrees=180)
xy_5 = XYPlane(Origin=pt_8)
neg_12 = Negative(Value=series_2)
move_26 = Move(Geometry=move_25.Geometry, Motion=Y_12)  # -> Geometry, Transform
neg_13 = Negative(Value=X_15)
move_27 = Move(Geometry=move_23.Geometry, Motion=X_16)  # -> Geometry, Transform
xz_4 = XZPlane(Origin=Point(0, 0, 0))
yz_3 = YZPlane(Origin=Point(0, 0, 0))
pt_9 = PointXYZ(XComponent=0, YComponent=0, ZComponent=0, System=PlaneXY(0, 0, 0))
pt_10 = PointXYZ(XComponent=0, YComponent=neg_12, ZComponent=0, System=PlaneXY(0, 0, 0))
Y_13 = UnitY(Factor=neg_11)
addition_14 = Addition(A=multiplication, B=nesting_space)
addition_15 = Addition(A=table_height_mm, B=0.01)
mirror_5 = Mirror(Geometry=move_27.Geometry, Plane=xz_4)  # -> Geometry, Transform
xz_5 = XZPlane(Origin=Point(0, 0, 0))
extr_2 = Extrude(Base=move_26.Geometry, Direction=Y_13)
vec2pt_6 = Vector2Pt(PointA=pt_9, PointB=pt_10, Unitize=False)  # -> Vector, Length
Y_14 = UnitY(Factor=addition_14)
extr_3 = Extrude(Base=[move_24.Geometry, mirror_5.Geometry, move_27.Geometry], Direction=neg_13)
Z_5 = UnitZ(Factor=addition_15)
crv_2 = Curve([mirror_4.Geometry, cir])
move_28 = Move(Geometry=cap, Motion=Z_5)  # -> Geometry, Transform
move_29 = Move(Geometry=[join_6, join_7, crv_2], Motion=X_13)  # -> Geometry, Transform
rotate_8 = Rotate(Geometry=move_29.Geometry, Angle=rad_8, Plane=xy_5)  # -> Geometry, Transform
cap_2 = CapHoles(Brep=extr_2)
mirror_6 = Mirror(Geometry=cap_2, Plane=xz_5)  # -> Geometry, Transform
move_30 = Move(Geometry=rotate_8.Geometry, Motion=Y_14)  # -> Geometry, Transform
item_5 = ListItem(List=flatten(move_30.Geometry), Index=0, Wrap=False)
crv_cp_2 = CurveCP(Point=pt_7, Curve=item_5)  # -> Point, Parameter, Distance
item_6 = ListItem(List=flatten(crv_cp_2.Point), Index=0, Wrap=False)
pcomp = Decompose(Point=item_6, System=PlaneXY(0, 0, 0))  # -> XComponent, YComponent, ZComponent
addition_16 = Addition(A=pcomp.XComponent, B=dist)
series_3 = Series(Start=addition_16, Step=addition_6, Count=multiplication_12)
pt_11 = PointXYZ(XComponent=series_3, YComponent=0, ZComponent=0, System=PlaneXY(0, 0, 0))
vec2pt_7 = Vector2Pt(PointA=item_4, PointB=pt_11, Unitize=False)  # -> Vector, Length
move_31 = Move(Geometry=graft(rotate_4.Geometry), Motion=vec2pt_7.Vector)  # -> Geometry, Transform
cap_3 = CapHoles(Brep=extr_3)
mirror_7 = Mirror(Geometry=cap_3, Plane=yz_3)  # -> Geometry, Transform
move_32 = Move(Geometry=join_4, Motion=vec2pt_6.Vector)  # -> Geometry, Transform
material = CreateMaterial(Diffuse=RGB(28, 28, 28), Specular=RGB(255, 255, 255), Emission=RGB(0, 0, 0), Transparency=0, Shine=0)
material_2 = CreateMaterial(Diffuse=RGB(255, 255, 255), Specular=RGB(255, 255, 255), Emission=RGB(54, 54, 54), Transparency=0, Shine=0)
wires = BrepWireframe(Brep=move_28.Geometry, Density=-1)
preview = CustomPreview(Geometry=wires, Shader=material)
preview_2 = CustomPreview(Geometry=move_28.Geometry, Shader=material_2)
preview_3 = CustomPreview(Geometry=[cap_3, mirror_7.Geometry, mirror_6.Geometry, cap_2], Shader=material)
_3d_preview = Brep([cap_2, mirror_6.Geometry, move_28.Geometry, cap_3, mirror_7.Geometry])  # disabled
# Bake for CNC milling
_2d_parts = Geometry([rectangle.Rectangle, move_32.Geometry, move_31.Geometry, move_29.Geometry, move_30.Geometry])
